vi "Main (Simulation)_v01.gvi"   [LabVIEW Communications System Design Software 2.0.1]
# This VI calculates waveform’s V^2(RMS) to use it to notmalize it’s amllitude to 1
panel controls:
  "Project Parameters": i32
  "Eb/N0 (SNR) [dB]": f64 = 50
  "stop": bool
  "symbol rate (baud)": f64 = 10000
  "Block selection": T1 = "Raw data+CRC+Coding+Modulation"
  "Data Measurements": i32 = 1
  "Coding and CRC": "Coding and CRC.gtype" = {"Rate (k/n)"="1/2", "CRC seed"=56797}
  "Burst parameters": "Burst Parameters.gtype" = {"# Message Symbols"=1000, "# Guard Symbols"=80, "Sync Bits"=64250}
  "Reinitialize": bool
  "Filter": "Filter.gtype" = {"Transmit filter"="Root Raised Cos", "Pulse filter parameter"=0.5, "Receive filter"="Root Raised Cos", "Matched filter parameter"=0.5}
panel indicators:
  "CRC result": u16
  "BER": f64
  "# Recieved bits": i32
  "Constellation Graph": T2[]
  "CRC LED": bool
  "Code LED": bool
  "Data LED": bool
  "Mod LED": bool
  "Eye Diagram": cluster{"t0": f64, "dt": f64, "Y": f64[]}[]
  "Power Spectrum": T3
  "Sync LED": bool
  "# Sent bits": i32
  "Eb/N0 [dB] (num)": f64
  "Sync Error": bool
  "Matched filter coefficients": f64[]
  "Pulse shaping filter coefficients": f64[]
  "Channel Est LED": bool
  "Error Out": error
  "Trellis": cluster{"t0": f64, "dt": f64, "phase": f64[]}[]
  "Time": i8[][]
  "Averaged BER": f64
  "Averaged BLER": f64
types:
  T1 = enum{"Raw data", "Raw data+CRC", "Raw data+CRC+Coding", "Raw data+CRC+Coding+Modulation"}
  T2 = cluster{"constellation": f64[], "oversampled data": f64[]}
  T3 = cluster{"f0": f64, "df": f64, "magnitude": f64[]}
  "Coding and CRC.gtype" = cluster{"Rate (k/n)": enum{"1/2", "2/3"}, "CRC seed": u16}
  "Burst Parameters.gtype" = cluster{"# Message Symbols": i32, "# Guard Symbols": i32, "Sync Bits": u16}
  T4 = enum{"none", "Raised Cosine", "Root Raised Cos", "Gaussian"}
  "Filter.gtype" = cluster{"Transmit filter": T4, "Pulse filter parameter": f64, "Receive filter": T4, "Matched filter parameter": f64}
  T5 = cluster{"samples per symbol": i32, "M-PSK": i32, "differential PSK": enum{"disable", "enable"}, "PSK type": enum{"normal", "shifted", "offset"}}
  T6 = enum{"Eye Diagram", "Constellation Graph", "Spectrum", "BER", "Trellis"}
  T7 = enum{"No averaging", "Vector averaging", "RMS averaging", "Peak hold"}
  "Averaging Parameters.gtype" = cluster{"averaging mode": T7, "weighting mode": enum{"Linear", "Exponential"}, "number of averages": u32}
uses:
  NI::Analysis::Measurement::Power Spectrum for 1 Chan (CDB).gvi
diagram:
  while {
    w1 = T5 {"samples per symbol"=16, "M-PSK"=2, "differential PSK"="enable", "PSK type"="normal"}
    call "Modulation init.gvi"(PSK Parameters=w1, Filter=$Filter, Burst Parameters=$"Burst parameters", Coding and CRC=$"Coding and CRC") -> (Demodulation parameters=w2, Modulation parameters=w3, error out=w4)
    Property Node(instance in=w2) -> ("pulse shaping filter coefficients"=w5, "matched filter coefficients"=w6)
    $"Pulse shaping filter coefficients" <- w5
    $"Matched filter coefficients" <- w6
    w7 = $"symbol rate (baud)"
    Property Node(instance in=w1) -> ("samples per symbol"=w8, "M-PSK"=w9)
    # 1.
    w10 = $"Block selection"
    To Double Precision Float(number=w9) -> w11
    Logarithm Base 2(x=w11) -> w12
    To Long Integer(number=w12) -> w13
    # 2.
    # 3.
    # 4.
    # 7.
    # 8.
    # 1. Initializing the modulation. (Mod type, Filters, sync parameters)
    # 2. Generating data. (Burst generation, coding, modulation,...)
    # 3. Add AWGN noise to output waveform for simulation.
    # 4. Recieving data. (Demodulation, decoding, processing...)
    # 5. Handling the indicators on the user interface.
    # 6. Processing the measurement selected by the Data Measurement tab. (In this case only the displayed measurement will be processed for saving processor resources.
    # 7. The While loop stops if Stop button is pressed or error occured.
    while {
      Wait(time to wait=200)
      call "Tx data processing.gvi"(error in=w4, Block selection=w10, Modulation parameters=w3, symbol rate (baud)=w7) -> (Data=w14, Output Bit Stream=w15, error out=w16)
      Property Node(instance in=w14) -> ("Modulated Waveform"=w17, instance out=w18)
      call "MT Add AWGN.gvi"(input complex waveform=w17, samples per symbol=w8, bits per symbol=w13, eb/n0=$"Eb/N0 (SNR) [dB]", error in=w16) -> (output complex waveform=w19, error out=w20)
      Property Node(instance in=w18, "Modulated Waveform"=w19) -> (instance out=w21)
      call "Rx data processing.gvi"(Data=w21, Demodulation paremeters=w2, error in=w20, Block selection=w10) -> (error out=w22, Sync found=w23, Decoded bitstream array=w24, CRC value (out) array=w25, Recieved waveform (filtered)=w26)
      Array Index(array=w24) -> (out0[_, _]=w27)
      Build Array(w15, w27) -> w28
      $Time <- w28
      To Unsigned Word Integer(number=$"Data Measurements") -> w29
      Type Cast(type=T6 "Trellis", x=w29) -> w30
      # 6.
      case (w30) {
        frame "Eye Diagram", Default {
          Property Node(instance in=w26) -> ("Y"=w32, instance out=w33)
          Array Subset(array=w32, length0=2000) -> w34
          Property Node(instance in=w33, "Y"=w34) -> (instance out=w35)
          call "MT Format Eye Diagram (complex).gvi"(waveform=w35, symbol rate=w7, eye length=2, I/Q="I", error in=w22) -> (eye diagram=w36, error out=w31)
          $"Eye Diagram" <- w36
        }
        frame "Constellation Graph" {
          call "MT Format Constellation.gvi"(waveform=w26, samples per symbol=w8) -> (constellation graph=w37, error out=w31)
          $"Constellation Graph" <- w37
        }
        frame "BER" {
          Array Size(array=w15) -> (size(s)=w38)
          $"# Sent bits" <- w38
          Not(x=w23) -> w39
          $"Sync Error" <- w39
          Array Index(array=w25) -> (out0[_, _]=w40)
          Add Array Elements(numeric array=w40) -> (sum=w41)
          Array Index(array=w24) -> (out0[_, _]=w42)
          Array Size(array=w42) -> (size(s)=w43)
          Is Equal To 0(x=w43) -> w44
          Select(s=w44, t=999, f=w41) -> w45
          $"CRC result" <- w45
          Select(s=w44, t=0, f=w43) -> w46
          $"# Recieved bits" <- w46
          call "BLER.gvi"(Number of averages=50, Input bits=w24, Reference bits=w15) -> (Averaged BLER=w47)
          $"Averaged BLER" <- w47
          call "MT Calculate BER After Trigger (User Pattern).gvi"(input bit stream=w42, reference bit pattern=w15, error in=w22) -> (BER=w48, error out=w31)
          $BER <- w48
          call "BER.gvi"(Number of averages=10, Reference bits=w15, Input bits=w24) -> (Averaged BER=w49)
          $"Averaged BER" <- w49
        }
        frame "Spectrum" {
          Property Node(instance in=w26) -> ("Y"=w50, "dt"=w51)
          Build Waveform Node(Y=w50, dt=w51) -> (output waveform=w52)
          w53 = "Averaging Parameters.gtype" {"averaging mode"="RMS averaging", "weighting mode"="Exponential", "number of averages"=10}
          call "Power Spectrum for 1 Chan (CDB).gvi"(signal=w52, averaging parameters=w53, dB on=TRUE, error in=w22) -> (power spectrum=w54, error out=w31)
          $"Power Spectrum" <- w54
        }
        frame "Trellis" {
          Property Node(instance in=w26) -> ("Y"=w55, instance out=w56)
          Array Subset(array=w55, length0=2000) -> w57
          Property Node(instance in=w56, "Y"=w57) -> (instance out=w58)
          call "MT Format Trellis Diagram.gvi"(waveform=w58, symbol rate=w7, trellis length=2, error in=w22) -> (trellis diagram=w59, error out=w31)
          $Trellis <- w59
        }
      }
      call "Filter Error Code.gvi"(code to clear=-21804, error in=w31) -> (error out=w60)
      $"Error Out" <- w60
      $"Eb/N0 [dB] (num)" <- $"Eb/N0 (SNR) [dB]"
      w61 = $stop
      Logical Or(w60, $Reinitialize, w61) -> w62
      # 5.
      call "Front Panel handler.gvi"(Enum=w10) -> (CRC LED=w63, Code LED=w64, Data LED=w65, Mod LED=w66)
      $"CRC LED" <- w63
      $"Code LED" <- w64
      $"Data LED" <- w65
      $"Mod LED" <- w66
      $"Sync LED" <- w66
      $"Channel Est LED" <- w66
      stop if w62
    }
    Logical Or(w60, w61) -> w67
    stop if w67
  }
  call "Display Error.gvi"(error in=w60)
