vi "Burst Building.gvi"   [LabVIEW Communications System Design Software 2.0.1]
inputs:
  "Sync Bits": u16
  "Input bit stream": i8[]
  "error in": error
  "# Guard Symbols": i32 = 128
outputs:
  "Output bit stream": i8[]
  "error out": error
diagram:
  # 1. Guard bits are all ones. (111..1). half-half of the guard is placed atthe begining and the end of the burst.
  # 2. Sync bits are already existing only conversion is needed from number to array.
  # 3. After everything is generated, guard and sync bits are added to the msg. (Guard/2+Sync+MSG bits+Guard bits/2, respectively)
  case ($"error in") {
    frame Error {
      w1 = $"Input bit stream"
      w2 = $"error in"
    }
    frame No Error {
      # ---------2------
      Number To Boolean Array(number=$"Sync Bits") -> (Boolean array=w3)
      Boolean To Integer(Boolean=w3) -> (0, 1=w4)
      To Byte Integer(number=w4) -> w5
      # Generate Guard
      Initialize Array(element=1, size=$"# Guard Symbols") -> w6
      Array Size(array=w6) -> (size(s)=w7)
      # ----------------------1--------------------------
      Divide(x=w7, y=2) -> w8
      Split 1D Array(array=w6, index=w8) -> (first subarray=w9, second subarray=w10)
      # 3
      # Guard bits are prepended
      # to Sync and message bits.
      Build Array[ConcatenateInputs=True](w9, w5, $"Input bit stream", w10) -> w1
      w2 = $"error in"
    }
  }
  $"Output bit stream" <- w1
  $"error out" <- w2
