vi "Convolutional Coder.gvi"   [LabVIEW Communications System Design Software 2.0.1]
inputs:
  "Input bitstream": i8[]
  "Rate (k/n)": enum{"1/2", "2/3"} = "1/2"
  "Error in": error
outputs:
  "Coded bit stream": i8[]
  "Error out": error
diagram:
  # 1
  # 2
  # 3
  # 1. Selecting the proper coder, based on the status of the enum "Rate (k/n)".
  # 2. Adding as many 0 bits to the end of the stream as the constraint length is of the specific coder. It is needed to prevent loosing data on the decoder side.
  # 3. Generating the coded bitstream.
  case ($"Error in") {
    frame Error {
      w1 = $"Error in"
      w2 = $"Input bitstream"
    }
    frame No Error {
      case ($"Rate (k/n)") {
        frame "1/2", Default {
          Array Size(array=$"Input bitstream") -> (size(s)=w3)
          Initialize Array(element=0, size=7) -> w4
          Insert Into Array(inArray=$"Input bitstream", index0=w3, new=w4) -> w5
          for {
            w6 = each element of w5
            Feedback Node(initial value=0, input=w7) -> w8
            Feedback Node(initial value=0, input=w6) -> w9
            Feedback Node(initial value=0, input=w9) -> w10
            Feedback Node(initial value=0, input=w10) -> w7
            Feedback Node(initial value=0, input=w11) -> w12
            Logical Exclusive Or(w12, w7, w10, w9, w6) -> w13
            Feedback Node(initial value=0, input=w8) -> w11
            Logical Exclusive Or(w12, w11, w7, w10, w6) -> w14
            Build Array(w14, w13) -> w15
            concatenate w15 onto w2
          }
          w1 = $"Error in"
        }
        frame "2/3" {
          Array Size(array=$"Input bitstream") -> (size(s)=w16)
          Initialize Array(element=0, size=4) -> w17
          Insert Into Array(inArray=$"Input bitstream", index0=w16, new=w17) -> w18
          Decimate Array(array=w18) -> (out0=w19, out1=w20)
          for {
            w21 = each element of w19
            w22 = each element of w20
            Feedback Node(initial value=0, input=w22) -> w23
            Feedback Node(initial value=0, input=w23) -> w24
            Feedback Node(initial value=0, input=w25) -> w26
            Logical Exclusive Or(w26, w21, w23, w24) -> w27
            Feedback Node(initial value=0, input=w21) -> w28
            Feedback Node(initial value=0, input=w28) -> w25
            Logical Exclusive Or(w26, w25, w28, w22, w24) -> w29
            Logical Exclusive Or(w28, w21, w23) -> w30
            Build Array(w27, w29, w30) -> w31
            concatenate w31 onto w2
          }
          w1 = $"Error in"
        }
      }
    }
  }
  $"Coded bit stream" <- w2
  $"Error out" <- w1
