vi "LFSR Generation.gvi"   [LabVIEW Communications System Design Software 2.0.1]
inputs:
  "# of bits to genreate": i32 = 140
  "PN sequence orger": "Sequency order.gtype" = "10"
  "Error In": error
outputs:
  "bits out": i8[]
  "Histogram of bits out": T1
  "Error Out": error
panel indicators:
  "spectrum of bits out": T2
types:
  T1 = cluster{"x values": f64[], "histogram h(x)": f64[]}
  "Sequency order.gtype" = enum{"6", "8", "10"}
  T2 = cluster{"f0": f64, "df": f64, "magnitude": f64[]}
uses:
  NI::Analysis::Measurement::Power Spectrum for 1 Chan.gvi
  NI::Analysis::Statistics::Histogram (single-shot)(DBL Array).gvi
diagram:
  case ($"Error In") {
    frame Error {
      w1 = default
      w2 = default
      w3 = $"Error In"
      w4 = default
    }
    frame No Error {
      for (N = $"# of bits to genreate") {
        case ($"PN sequence orger") {
          frame "6", Default {
            Is First Call() -> w6
            Feedback Node(input=w7) -> w8
            Feedback Node(input=w8) -> w9
            Feedback Node(input=w10) -> w11
            Feedback Node(input=w11) -> w5
            Logical Exclusive Or(w5, w11, w9, w8) -> w12
            Select(s=w6, t=TRUE, f=w12) -> w13
            Feedback Node(input=w13) -> w7
            # 02356
            Feedback Node(input=w9) -> w10
          }
          frame "8" {
            Is First Call() -> w14
            Feedback Node(input=w15) -> w16
            # 04568
            Feedback Node(input=w16) -> w17
            Feedback Node(input=w17) -> w18
            Feedback Node(input=w19) -> w5
            Logical Exclusive Or(w5, w18, w17, w16) -> w20
            Select(s=w14, t=TRUE, f=w20) -> w21
            Feedback Node(input=w21) -> w22
            Feedback Node(input=w22) -> w23
            Feedback Node(input=w23) -> w15
            Feedback Node(input=w18) -> w19
          }
          frame "10" {
            Is First Call() -> w24
            Feedback Node(input=w25) -> w26
            Feedback Node(input=w27) -> w5
            Logical Exclusive Or(w5, w26) -> w28
            Select(s=w24, t=TRUE, f=w28) -> w29
            Feedback Node(input=w29) -> w30
            Feedback Node(input=w30) -> w31
            Feedback Node(input=w31) -> w32
            Feedback Node(input=w32) -> w33
            # 0 7 10
            Feedback Node(input=w33) -> w34
            Feedback Node(input=w34) -> w25
            Feedback Node(input=w26) -> w35
            Feedback Node(input=w35) -> w27
          }
        }
        Boolean To Integer(Boolean=w5) -> (0, 1=w36)
        To Byte Integer(number=w36) -> w37
        append w37 to w2
      }
      call "Power Spectrum for 1 Chan.gvi"(signal=w2, dB on=TRUE, error in=$"Error In") -> (power spectrum=w4, error out=w38)
      call "Histogram (single-shot)(DBL Array).gvi"(signal=w2, error in=$"Error In") -> (histogram=w1, error out=w39)
      Merge Errors(w38, w39) -> (error out=w3)
    }
  }
  $"bits out" <- w2
  $"spectrum of bits out" <- w4
  $"Histogram of bits out" <- w1
  $"Error Out" <- w3
