vi "Demodulation (PSK).gvi"   [LabVIEW Communications System Design Software 2.0.1]
inputs:
  "Waveform in": cluster{"t0": f64, "dt": f64, "Y": c128[]} = {"t0"=0, "dt"=1, "Y"=[]}
  "error in": error
  "Demodulation parameters": "Demodulation parameters.gtype"
outputs:
  "Messages out": i8[][]
  "error out": error
  "Sync found": bool
  "output complex waveform": cluster{"t0": f64, "dt": f64, "Y": c128[]}
panel indicators:
  "product": c128
  "Graph": f64[]
types:
  T1 = cluster{"samples per symbol (16)": i32, "symbol map": c128[], "differential PSK": enum{"disable", "enable"}, "PSK type": enum{"normal", "shifted", "offset"}}
  "Burst Parameters.gtype" = cluster{"# Message Symbols": i32, "# Guard Symbols": i32, "Sync Bits": u16}
  "Coding and CRC.gtype" = cluster{"Rate (k/n)": enum{"1/2", "none"}, "CRC seed": u16}
  "Demodulation parameters.gtype" = cluster{"PSK system parameters": T1, "pulse shaping filter coefficients": f64[], "matched filter coefficients": f64[], "Burst Parameters": "Burst Parameters.gtype", "Coding and CRC": "Coding and CRC.gtype"}
diagram:
  # 1. Matched Filtering
  # 2. Finding the middle of a symbol  (as it was oversampled) using gardner algorithm.
  # 3. Decimate oversampled data using error array of gardner.
  # 4. turn BPSK symbols to 0 and 1. (decision making)
  # 5. Find sync sequence. If found cut down the message bits from burst (guard and sinc bits)
  # 6. Calculating the lenght of the message symbols. (add CRC; + additional bits from coding; multibly because of the code rate.)
  case ($"error in") {
    frame Error {
      w1 = $"error in"
      w2 = default
      w3 = $"Waveform in"
      w4 = default
    }
    frame No Error {
      # 1
      call "Matched Filtering.gvi"(Modulated waveform in=$"Waveform in", Error in=$"error in", Demodulation parameters=$"Demodulation parameters") -> (Filtered waveform out=w3, Filtered bits out=w5, Error out=w6)
      Complex To Real Imaginary(x + iy=w5) -> (x=w7)
      $Graph <- w7
      Property Node(instance in=$"Demodulation parameters") -> ("Burst Parameters:Sync Bits"=w8, "Burst Parameters:# Message Symbols"=w9, "Coding and CRC:Rate (k/n)"=w10)
      call "Timing Recovery.gvi"(Bits in=w5, Demodulation parameters=$"Demodulation parameters", Error In=w6) -> (Error array=w11, Error Out=w12, Bits out=w13)
      call "Decimating.gvi"(Error arary in=w11, Bits in=w13, Demodulation parameters=$"Demodulation parameters", Error In=w12) -> (Decimated bits out=w14, Error Out=w15)
      call "Decision.gvi"(Bits in=w14, Error In=w15) -> (Demodulated bits=w16, Error Out=w17)
      # w10: Coding Rate
      # 6
      case (w10) {
        frame "1/2", Default {
          w18 = 2
          w19 = 7
        }
        frame "none" {
          Divide(x=3, y=2) -> w18
          w19 = 4
        }
      }
      # w9: #Message symbols
      Add(w9, 16) -> w20
      # w8: Sync bits
      Add(w20, w19) -> w21
      To Double Precision Float(number=w21) -> w22
      Multiply(w22, w18) -> w23
      To Long Integer(number=w23) -> w24
      # 5
      call "Sync search.gvi"(Bits in=w16, Sync bits=w8, Burst Parameters:# Message Symbols=w24, Error In=w17) -> (Sync found=w2, Messages out=w4, Error Out=w1)
      # 2
      call "Timing Recovery_2.gvi"(Filtered waveform out=w3, Demodulation parameters=$"Demodulation parameters") -> (product=w25)
      # 3
      # 4
      $product <- w25
    }
  }
  $"output complex waveform" <- w3
  $"Messages out" <- w4
  $"Sync found" <- w2
  $"error out" <- w1
