vi "Matched Filtering.gvi"   [LabVIEW Communications System Design Software 2.0.1]
inputs:
  "Modulated waveform in": cluster{"t0": f64, "dt": f64, "Y": c128[]}
  "Error in": error
  "Demodulation parameters": "Demodulation parameters.gtype"
outputs:
  "Filtered waveform out": cluster{"t0": f64, "dt": f64, "Y": c128[]}
  "Filtered bits out": c128[]
  "Error out": error
types:
  T1 = cluster{"samples per symbol (16)": i32, "symbol map": c128[], "differential PSK": enum{"disable", "enable"}, "PSK type": enum{"normal", "shifted", "offset"}}
  "Burst Parameters.gtype" = cluster{"# Message Symbols": i32, "# Guard Symbols": i32, "Sync Bits": u16}
  "Coding and CRC.gtype" = cluster{"Rate (k/n)": enum{"1/2", "2/3"}, "CRC seed": u16}
  "Demodulation parameters.gtype" = cluster{"PSK system parameters": T1, "pulse shaping filter coefficients": f64[], "matched filter coefficients": f64[], "Burst Parameters": "Burst Parameters.gtype", "Coding and CRC": "Coding and CRC.gtype"}
  "filter structure.gtype" = u32
  "filter.gtype" = cluster{"filter structure": "filter structure.gtype", "forward coefficients": f64[], "reverse coefficients": f64[], "sampling frequency": f64}
uses:
  NI::Analysis::Filtering::Filtering (CDB).gvi
diagram:
  # ---------------------------------1----------------------------------
  # 2
  # 3
  # 1. If no filter used, the array doesn't contain evrything. In this case we assuem that 1 bit is the length of the array
  # 2. Adding elements to the end of the array that will be cut down by the filter. I have added more, because the rest will be cut down after sync found
  # 		# of 0+j bits = 2*samples per symbol*(filter length+1)
  # 3. Matched filtering.
  case ($"Error in") {
    frame Error {
      w1 = $"Error in"
      w2 = $"Modulated waveform in"
      w3 = c128[] []
    }
    frame No Error {
      Property Node(instance in=$"Modulated waveform in") -> ("Y"=w4, instance out=w5)
      Array Size(array=w4) -> (size(s)=w6)
      Property Node(instance in=$"Demodulation parameters") -> ("matched filter coefficients"=w7, "PSK system parameters:samples per symbol (16)"=w8)
      # w7: Matched Filter Coefficients
      Array Size(array=w7) -> (size(s)=w9)
      # w8: Samples ber symbol
      Decrement(x=w9) -> w10
      Is Less Or Equal To 0(x=w10) -> w11
      Select(s=w11, t=1, f=w10) -> w12
      Multiply(2, w12) -> w13
      Multiply(w13, w8) -> w14
      Initialize Array(element=1+1i, size=w14) -> w15
      Insert Into Array(inArray=w4, index0=w6, new=w15) -> w16
      Property Node(instance in=w5, "Y"=w16) -> (instance out=w17)
      w18 = "filter.gtype" {"filter structure"=3, "forward coefficients"=[], "reverse coefficients"=[], "sampling frequency"=0}
      Property Node(instance in=w18, "forward coefficients"=w7) -> (instance out=w19)
      call "Filtering (CDB).gvi"(signal=w16, filter=w19) -> (filtered signal=w20)
      Delete From Array(inArray=w20, length (1)=w6, index0=0) -> (deleted=w3)
      Property Node(instance in=w17, "Y"=w3) -> (instance out=w2)
      # Matched filtering
      call "MT Apply Matched Filter (Generic).gvi"(input complex waveform=w17, matched filter coefficients=w7, samples per symbol=w8, error in=$"Error in") -> (output complex waveform=w21, error out=w1)
      Property Node(instance in=w21)
    }
  }
  $"Filtered waveform out" <- w2
  $"Filtered bits out" <- w3
  $"Error out" <- w1
