vi "Timing Recovery.gvi"   [LabVIEW Communications System Design Suite 2.0.1]
inputs:
  "Bits in": c128[]
  "Demodulation parameters": "Demodulation parameters.gtype"
  "Error In": error
outputs:
  "Error array": c128[]
  "Error Out": error
  "Bits out": c128[]
types:
  T1 = cluster{"samples per symbol (16)": i32, "symbol map": c128[], "differential PSK": enum{"disable", "enable"}, "PSK type": enum{"normal", "shifted", "offset"}}
  "Burst Parameters.gtype" = cluster{"# Message Symbols": i32, "# Guard Symbols": i32, "Sync Bits": u16}
  "Coding and CRC.gtype" = cluster{"Rate (k/n)": enum{"1/2", "2/3"}, "CRC seed": u16}
  "Demodulation parameters.gtype" = cluster{"PSK system parameters": T1, "pulse shaping filter coefficients": f64[], "matched filter coefficients": f64[], "Burst Parameters": "Burst Parameters.gtype", "Coding and CRC": "Coding and CRC.gtype"}
diagram:
  # 1
  # 2
  # Processing Gardner algorithm to find the clear constellation point. Error = [y(n)-y(n-2)]*y(n-1). The more it is to zero the more ($n$==?) probably it is a clear constellation point.
  case ($"Error In") {
    frame Error {
      w1 = default
      w2 = $"Bits in"
      w3 = $"Error In"
    }
    frame No Error {
      Property Node(instance in=$"Demodulation parameters") -> ("PSK system parameters:samples per symbol (16)"=w4)
      Divide(x=w4, y=2) -> w5
      To Long Integer(number=w5) -> w6
      # Gardner
      # f(bit)*oversampling
      # w4: Samples per symbol
      for (iteration -> i1) {
        w7 = each element of $"Bits in"
        Add(w6, i1) -> w9
        Array Index(array=$"Bits in") -> (out0[w9]=w10)
        Multiply(2, w6) -> w11
        Add(w11, i1) -> w12
        Array Index(array=$"Bits in") -> (out0[w12]=w13)
        Add(w13, w7) -> w14
        Add(w14, w10) -> w15
        append w15 to w8
      }
      Array Size(array=w8) -> (size(s)=w16)
      Subtract(x=w16, y=w4) -> w17
      Delete From Array(inArray=w8, length (1)=w4, index0=w17) -> w1
      w2 = $"Bits in"
      w3 = $"Error In"
    }
  }
  $"Bits out" <- w2
  $"Error array" <- w1
  $"Error Out" <- w3
