vi "Modulation (PSK).gvi"   [LabVIEW Communications System Design Software 2.0.1]
inputs:
  "input bit stream": i8[]
  "Modulation parameters": "Modulation parameters.gtype"
  "symbol rate": f64 = 1
  "error in": error
outputs:
  "error out": error
  "output complex waveform": cluster{"t0": f64, "dt": f64, "Y": c128[]}
  "Modulated bits": c128[]
types:
  T1 = cluster{"samples per symbol": i32, "M-PSK": i32, "differential PSK": enum{"disable", "enable"}, "PSK type": enum{"normal", "shifted", "offset"}}
  "Burst Parameters.gtype" = cluster{"# Message Symbols": i32, "# Guard Symbols": i32, "Sync Bits": u16}
  "Coding and CRC.gtype" = cluster{"Rate (k/n)": enum{"1/2", "2/3"}, "CRC seed": u16}
  "Modulation parameters.gtype" = cluster{"PSK Parameters": T1, "pulse shaping filter coefficients": f64[], "Burst Parameters": "Burst Parameters.gtype", "Coding and CRC": "Coding and CRC.gtype"}
diagram:
  Property Node(instance in=$"Modulation parameters") -> ("PSK Parameters:samples per symbol"=w1, "pulse shaping filter coefficients"=w2)
  # 1
  # 2
  # 3
  # 1. The for loop takes evry bit one by one.
  # 2. If the corresponding bit is '0', the output will be the same. If it is '1', then it will bew negated. The shift register is there so the VI will know its state after each bit, so the negation can be done.
  # 3. Desired filter applied. It also generates more bits per symbol, so samples per symbol can be achieved.
  case ($"error in") {
    frame Error {
      w3 = $"error in"
      w4 = default
      w5 = default
    }
    frame No Error {
      for {
        w6 = each element of $"input bit stream"
        Is Equal(x=w6, y=1) -> w7
        Feedback Node(initial value=0+1i, input=w8) -> w9
        case (w7) {
          frame False, Default {
            w8 = w9
          }
          frame True {
            Negate(x=w9) -> w8
          }
        }
        append w8 to w5
      }
      call "MT Apply Pulse Shaping Filter (Generic).gvi"(symbols=w5, pulse shaping filter coefficients=w2, samples per symbol=w1, symbol rate=$"symbol rate", error in=$"error in", reset?=FALSE) -> (output complex waveform=w4, error out=w3)
    }
  }
  $"Modulated bits" <- w5
  $"output complex waveform" <- w4
  $"error out" <- w3
