vi "Differencial logic.gvi"   [LabVIEW Communications System Design Software 2.0.1]
inputs:
  "Burst bits in": i8[]
  "Error In": error
outputs:
  "Bits out": c128[]
  "Error Out": error
diagram:
  # 1. The for loop takes evry bit one by one.
  # 2. If the corresponding bit is '0', the output will be the same. If it is '1', then it will be delayed by 180 degrees. The shift register is there so the VI will know its state after each bit, so the reference is provided.
  case ($"Error In") {
    frame Error {
      w1 = default
      w2 = $"Error In"
    }
    frame No Error {
      for {
        w3 = each element of $"Burst bits in"
        Is Equal(x=w3, y=1) -> w4
        Feedback Node(initial value=0, input=w5) -> w6
        case (w4) {
          frame False, Default {
            w5 = w6
          }
          frame True {
            Add(w6, Pi) -> w5
          }
        }
        Polar To Complex(r=1, theta=w5) -> (r * e^(i*theta)=w7)
        append w7 to w1
      }
      w2 = $"Error In"
    }
  }
  $"Bits out" <- w1
  $"Error Out" <- w2
