vi "Pulse Shaping Filter.gvi"   [LabVIEW Communications System Design Software 2.0.1]
inputs:
  "Bits in": c128[]
  "Filter Coefficients": f64[]
  "Symbol Rate [Hz]": f64
  "Error in": error
  "Samples per Symbol": i32
outputs:
  "Modulated bits out": c128[]
  "Modulated waveform out": cluster{"t0": f64, "dt": f64, "Y": c128[]}
  "Error out": error
types:
  "filter structure.gtype" = u32
  "filter.gtype" = cluster{"filter structure": "filter structure.gtype", "forward coefficients": f64[], "reverse coefficients": f64[], "sampling frequency": f64}
uses:
  NI::Analysis::Filtering::Filtering (CDB).gvi
diagram:
  case ($"Error in") {
    frame Error {
      w1 = $"Bits in"
      w2 = default
      w3 = $"Error in"
    }
    frame No Error {
      Multiply($"Samples per Symbol", $"Symbol Rate [Hz]") -> w4
      # 2
      Reciprocal(x=w4) -> w5
      Array Size(array=$"Filter Coefficients") -> (size(s)=w6)
      # 1
      Array Subset(array=$"Bits in", index0=0, length0=w6) -> w7
      Build Array[ConcatenateInputs=True](w7, $"Bits in") -> w8
      w9 = "filter.gtype" {"filter structure"=3, "forward coefficients"=[], "reverse coefficients"=[], "sampling frequency"=0}
      Property Node(instance in=w9, "forward coefficients"=$"Filter Coefficients") -> (instance out=w10)
      # 3
      call "Filtering (CDB).gvi"(signal=w8, filter=w10, error in=$"Error in") -> (filtered signal=w11, error out=w3)
      # 4
      Delete From Array(inArray=w11, length (1)=w6, index0=0) -> w1
      w12 = cluster{"t0": f64, "dt": f64, "Y": c128[]} {all zero or empty}
      Property Node(instance in=w12, "dt"=w5, "Y"=w1) -> (instance out=w2)
    }
  }
  $"Modulated bits out" <- w1
  $"Modulated waveform out" <- w2
  $"Error out" <- w3
