vi "Tx data processing.gvi"   [LabVIEW Communications System Design Software 2.0.1]
inputs:
  "error in": error
  "Block selection": T1 = "Raw data"
  "Modulation parameters": "Modulation parameters.gtype"
  "symbol rate (baud)": f64 = 10000
outputs:
  "Data": T2
  "Output Bit Stream": i8[]
  "error out": error
panel controls:
  "Tab": i32 = 1
types:
  T1 = enum{"Raw data", "Raw data+CRC", "Raw data+CRC+Coding", "Raw data+CRC+Coding+Modulation"}
  T2 = cluster{"Modulated Waveform": cluster{"t0": f64, "dt": f64, "Y": c128[]}, "Output Bit Stream": i8[]}
  T3 = cluster{"samples per symbol": i32, "M-PSK": i32, "differential PSK": enum{"disable", "enable"}, "PSK type": enum{"normal", "shifted", "offset"}}
  "Burst Parameters.gtype" = cluster{"# Message Symbols": i32, "# Guard Symbols": i32, "Sync Bits": u16}
  "Coding and CRC.gtype" = cluster{"Rate (k/n)": enum{"1/2", "none"}, "CRC seed": u16}
  "Modulation parameters.gtype" = cluster{"PSK Parameters": T3, "pulse shaping filter coefficients": f64[], "Burst Parameters": "Burst Parameters.gtype", "Coding and CRC": "Coding and CRC.gtype"}
diagram:
  Property Node(instance in=$"Modulation parameters") -> ("Burst Parameters"=w1, "PSK Parameters"=w2, "Burst Parameters:Sync Bits"=w3, "Coding and CRC"=w4, "pulse shaping filter coefficients"=w5, "Burst Parameters:# Message Symbols"=w6, instance out=w7)
  Property Node(instance in=w4) -> ("Rate (k/n)"=w8, "CRC seed"=w9)
  case ($"error in") {
    frame Error {
      w10 = $"error in"
      w11 = default
      w12 = default
      w13 = default
    }
    frame No Error, Default {
      case ($"Block selection") {
        frame "Raw data" {
          Property Node(instance in=w2) -> ("samples per symbol"=w14)
          Property Node(instance in=w1) -> ("# Message Symbols"=w15)
          call "Message bit generation.gvi"(# Message Symbols=w15, error in=$"error in") -> (Output Bit Stream=w12, error out=w16)
          To Double Precision Complex(number=w12) -> w17
          call "MT Apply Pulse Shaping Filter (Generic).gvi"(symbols=w17, pulse shaping filter coefficients=w5, samples per symbol=w14, symbol rate=$"symbol rate (baud)", error in=w16) -> (output complex waveform=w11, error out=w10)
          w13 = w12
        }
        frame "Raw data+CRC" {
          Property Node(instance in=w2) -> ("samples per symbol"=w18)
          Property Node(instance in=w1) -> ("# Message Symbols"=w19)
          call "Message bit generation.gvi"(# Message Symbols=w19, error in=$"error in") -> (Output Bit Stream=w13, error out=w20)
          call "CRC.gvi"(Message In=w13, CRC seed=w9, Error In=w20, Forward?=TRUE) -> (Data out=w12, Error Out=w21)
          To Double Precision Complex(number=w12) -> w22
          call "MT Apply Pulse Shaping Filter (Generic).gvi"(symbols=w22, pulse shaping filter coefficients=w5, samples per symbol=w18, symbol rate=$"symbol rate (baud)", error in=w21) -> (output complex waveform=w11, error out=w10)
        }
        frame "Raw data+CRC+Coding" {
          Property Node(instance in=w2) -> ("samples per symbol"=w23)
          Property Node(instance in=w1) -> ("# Message Symbols"=w24)
          call "Message bit generation.gvi"(# Message Symbols=w24, error in=$"error in") -> (Output Bit Stream=w13, error out=w25)
          call "CRC.gvi"(Message In=w13, CRC seed=w9, Error In=w25, Forward?=TRUE) -> (Data out=w26, Error Out=w27)
          call "Convolutional Coder.gvi"(Input bitstream=w26, Rate (k/n)=w8, Error in=w27) -> (Coded bit stream=w12, Error out=w28)
          To Double Precision Complex(number=w12) -> w29
          call "MT Apply Pulse Shaping Filter (Generic).gvi"(symbols=w29, pulse shaping filter coefficients=w5, samples per symbol=w23, symbol rate=$"symbol rate (baud)", error in=w28) -> (output complex waveform=w11, error out=w10)
        }
        frame "Raw data+CRC+Coding+Modulation", Default {
          Property Node(instance in=w1) -> ("# Message Symbols"=w30, instance out=w31)
          # 1
          call "Message bit generation.gvi"(# Message Symbols=w30, error in=$"error in") -> (Output Bit Stream=w13, error out=w32)
          # 2.
          call "CRC.gvi"(Message In=w13, CRC seed=w9, Error In=w32, Forward?=TRUE, # of MSG bits=w6) -> (Data out=w33, Error Out=w34)
          # 3.
          call "Convolutional Coder.gvi"(Input bitstream=w33, Rate (k/n)=w8, Error in=w34) -> (Coded bit stream=w35, Error out=w36)
          Property Node(instance in=w31) -> ("# Guard Symbols"=w37)
          # 4.
          call "Burst Building.gvi"(Sync Bits=w3, Input bit stream=w35, error in=w36, # Guard Symbols=w37) -> (Output bit stream=w12, error out=w38)
          # 5.
          call "Modulation (PSK).gvi"(input bit stream=w12, Modulation parameters=w7, symbol rate=$"symbol rate (baud)", error in=w38) -> (error out=w10, output complex waveform=w11)
        }
      }
    }
  }
  Build Cluster(w11, w12) -> w39
  $Data <- w39
  $"error out" <- w10
  $"Output Bit Stream" <- w13
